# Grasshopper definition example_file.gh (Grasshopper 1.0.7)
# plug-ins: g3gh Info

# ---- group: Read Mesh from file
getfolder = GetCurrentFolder()  # -> path
# ---------- getfolder: Python ----------
__author__ = "joelhilmersson"

import rhinoscriptsyntax as rs

import os


if(ghdoc.Path):
    path = os.path.dirname(ghdoc.Path)
# ---------- end getfolder ----------
concat = Concatenate(FragmentA=getfolder, FragmentB="stanfordbunny.obj", JoinSeparator="/")
dmshfromobj = ReadFromFile(FilePath=concat)

# ---- group: Mesh
dm3 = DMesh3(dmshfromobj)

# ---- group: Implicit Boolean Intersection
number_slider = Slider(86, range=0..100)
number_slider_2 = Slider(90, range=0..100)
dm3_2 = DMesh3(dm3)

# ---- group: Fill a mesh hole
dm3_3 = DMesh3(dm3)  # disabled

# ---- group: Fill all holes iteratively
dm3_4 = DMesh3(dm3)  # disabled

# ---- group: Fill a mesh hole
edgeloops = MeshBoundaryEdgeLoops(DMesh3=dm3_3)
edge_loop = EdgeLoop(edgeloops)
item = ListItem(List=edge_loop, Index=0, Wrap=True)

# ---- group: Reduce Mesh
toggle = BooleanToggle(False)
toggle_2 = BooleanToggle(False)

# ---- group: Live Remesher
toggle_3 = BooleanToggle(True)
button = Button()

# ---- group: Implicit Boolean Intersection
rotdmesh3 = Rotate(Mesh=<missing>, RotationAngle=number_slider_2, Plane=PlaneXY(0, 0, 0))
implinters = ImplicitIntersection(Meshes=[<missing>, rotdmesh3], NumberOfCells=number_slider)

# ----
dm3_5 = DMesh3(implinters)
dm3_6 = DMesh3(<missing>)
dm3_7 = DMesh3(<missing>)
dm3_8 = DMesh3(dm3_5)  # disabled

# ---- group: Smooth
laplacesmooth = SmoothMesh(Mesh=dm3_8, InteriorWeight=Slider(0.3, range=0..1))

# ----
compact = CompactMesh(Mesh=<missing>)
deconmsh = DeconstructMesh(Mesh=compact)  # -> VertexIndices, Vertices, FaceIndices, Faces, Colours

dm3_9 = DMesh3(laplacesmooth)
mesh_hole_fill = MeshHoleFill(Type=1)
iterative_mesh_hole_fill = IterativeMeshHoleFill(Type=2)
clean_mesh = CleanMesh(Dup=True, Fin=True, Occ=True, Un=True)
iterative_mesh_hole_fill_2 = IterativeMeshHoleFill(Type=2)

# ---- group: Live Remesher
dm3_10 = DMesh3(dm3)  # disabled

edgestats = MeshEdgeStatistics(Mesh=dm3_10)  # -> MaxEdgeLength, MinEdgeLength, AverageEdgeLength
multiplication = Multiplication(A=edgestats.AverageEdgeLength, B=Slider(2, range=0..10))

rmsh = Remesh(
    Mesh=dm3_10,
    TargetEdgeLength=multiplication,
    NumberOfIterations=Slider(10, range=0..10),
    ConstrainEdges=True,
    ProjectToInput=True,
    Run=toggle_3,
    Reset=button)

# ----
dm3_11 = DMesh3(rmsh)

# ---- group: Reduce Mesh
dm3_12 = DMesh3(dm3)  # disabled

deconmsh_2 = DeconstructMesh(Mesh=dm3_12)  # -> VertexIndices, Vertices, FaceIndices, Faces, Colours
lng = ListLength(List=deconmsh_2.Faces)
multiplication_2 = Multiplication(A=lng, B="0.01")

reduce = ReduceMesh(Mesh=dm3_12, NumberOfFaces=multiplication_2, ConstrainEdges=toggle_2, ProjectToInput=toggle)

# ----
dm3_13 = DMesh3(reduce)
dm3_14 = DMesh3(dm3_13)  # disabled
dm3_15 = DMesh3(dm3_13)  # disabled

# ---- group: Voxel + Boxmap
voxl = Voxelize(Mesh=dm3_15, NumberOfCells=64)
bbox = BoundingBox(Content=voxl, Plane=PlaneXY(0, 0, 0))  # -> Box, Box_2
bbox_2 = BoundingBox(Content=dm3_15, Plane=PlaneXY(0, 0, 0))  # -> Box, Box_2
mesh = Mesh(voxl)
boxmap = BoxMapping(Geometry=mesh, Source=bbox.Box, Target=bbox_2.Box)  # -> Geometry, Transform

# ----
deconmsh_3 = DeconstructMesh(Mesh=dm3_14)  # -> VertexIndices, Vertices, FaceIndices, Faces, Colours
deconmsh_4 = DeconstructMesh(Mesh=<missing>)  # -> VertexIndices, Vertices, FaceIndices, Faces, Colours

panel = Panel(deconmsh.FaceIndices)
panel_2 = Panel(deconmsh_4.FaceIndices)

pt = Point(deconmsh_3.Vertices)
pt_2 = Point(deconmsh_4.Vertices)

mesh_2 = Mesh(boxmap.Geometry)
